# Grasshopper definition Test1.gh (Grasshopper 1.0.8)

Z = UnitZ(Factor=Slider(10, range=0..10))
move = Move(Motion=Z)  # -> Geometry, Transform
rotate = Rotate(Angle=degrees(Slider(80, range=0..100)), Plane=PlaneXY(0, 0, 0))  # -> Geometry, Transform
c_script = CSharpScript(TS=rotate.Transform, TS2=move.Transform)  # -> out, a; inputs TS: Transform, TS2: Transform
# ---------- c_script: C# ----------
// Grasshopper Script Instance
#region Usings
#r "/Volumes/File/IBOIS/Courses/TimberResearch/SLBlockResearch/Program/VScode/bin/Debug/net7.0/VScode.dll"
using System;
using System.Linq;
using System.Collections;
using System.Collections.Generic;
using System.Drawing;
using Block;
using Rhino;
using Rhino.Geometry;

using Grasshopper;
using Grasshopper.Kernel;
using Grasshopper.Kernel.Data;
using Grasshopper.Kernel.Types;
#endregion

public class Script_Instance : GH_ScriptInstance
{
    #region Notes
    /* 
      Members:
        RhinoDoc RhinoDocument
        GH_Document GrasshopperDocument
        IGH_Component Component
        int Iteration

      Methods (Virtual & overridable):
        Print(string text)
        Print(string format, params object[] args)
        Reflect(object obj)
        Reflect(object obj, string method_name)
    */
    #endregion

    private void RunScript(Transform TS, Transform TS2, ref object a)
    {
        // Write your logic here
        var SL = new SLBlockPair(3);
        SL.Transform(TS);
        SL.Transform(TS2);
        var SL2 = SL.DuplicateSLBlockPair();
        
        a = SL2;
    }
}
# ---------- end c_script ----------
panel = Panel(c_script.a)
